# Grasshopper definition flocking1.gh (Grasshopper 0.9.76)
# plug-ins: gHowl

# ---- group: ReceiveOSC
send_pattern_osc = Panel("999")
port = Panel("12001")
udp = UDPReceiver(Port=port, Pattern=send_pattern_osc)  # -> Info, Data
message = Panel([udp.Info, udp.Data])
